# Grasshopper definition test.gh (Grasshopper 0.9.76)
# plug-ins: Circulation

geo = Geometry(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)
pt = Point(Point(-5.231090973, -6.169420303, 0))
geo_2 = Geometry(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)
pt_2 = Point(Point(4.756354243, 3.39075453, 0))
node = Node(Position=pt, Name="start", Floor="floor1")
node_2 = Node(Position=pt_2, Name="end", Floor="floor1")
floor = Floor(Boundary=geo, Name="floor1")
barrier = Barrier(Boundary=geo_2, Floor="floor1")
agent = Agent(Name="agent1", Origin="start", Destination="end")
environment = Environment(Entities=[floor, barrier, node, node_2], Resolution=Slider(1, range=0..10))  # -> Test, Sdf, Agent
